% Simulink data dictionary data.sldd

deltaT = Simulink.Parameter(0.001, StorageClass="ImportFromFile", HeaderFile="drone_external.h")
deltaT_sim = Simulink.Parameter(Simulink.data.Expression(ExpressionString="deltaT"), StorageClass="ImportFromFile", HeaderFile="drone_external.h")

mi_drone_acceleration_out_t = Simulink.Bus(DataScope="Imported", HeaderFile="drone_physics_matlab.h")
  du: double
  dv: double
  dw: double
  dp: double
  dq: double
  dr: double

mi_drone_acceleration_in_t = Simulink.Bus(DataScope="Imported", HeaderFile="drone_physics_matlab.h")
  phi: double
  theta: double
  psi: double
  u: double
  v: double
  w: double
  p: double
  q: double
  r: double
  thrust: double
  torque_x: double
  torque_y: double
  torque_z: double
  mass: double
  Ixx: double
  Iyy: double
  Izz: double
  gravity: double
  drag: double

Configuration = Simulink.ConfigSet(StartTime="0", StopTime="10", FixedStep="deltaT_sim", Solver="FixedStepDiscrete", ProdHWDeviceType="ARM Compatible->ARM Cortex-A", SystemTargetFile="ert.tlc", TargetLang="C")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